# Grasshopper definition Closing_tensegrity_modules_simulations.gh (Grasshopper 1.0.8)

# Enable the relays linked to the module you want to simulate and disable the others
number_slider = Slider(88, range=0..100)
point = Point(Point(0.0005380180613, -0.000457188339, 0))
point_2 = Point(Point(0.0005380180613, -0.000457188339, 0))
# Closing Module simulation
# T-3
cluster = T3()  # -> struts_2, radial_cables_2, vertical_cables_2
# Icosahedron
# Note that radialCables represent the cable
#  routine used to close the module and
# verticalCables represent the other cables of the module
c_script = CSharpScript(center=point, radius=number_slider)  # -> out, struts, radialCables, verticalCables, points, labels, labelLocations; inputs center: Point3d, radius: Double
# ---------- c_script: C# ----------
#region Usings
using System;
using System.Collections.Generic;
using Rhino.Geometry;
#endregion

public class Script_Instance : GH_ScriptInstance
{
    private void RunScript(
		Point3d center,
		double radius,
		ref object struts,
		ref object radialCables,
		ref object verticalCables,
		ref object points,
		ref object labels,
		ref object labelLocations)
    {
        List<Point3d> vertices = GenerateIcosahedron(center, radius);

        // Struts (compression)
        int[,] strutIndices = new int[,]
        {
            {0, 11}, {1, 4}, {2, 7}, {3, 9}, {5, 10}, {6, 8}
        };

        List<Line> strutLines = new List<Line>();
        for (int i = 0; i < strutIndices.GetLength(0); i++)
        {
            Point3d p1 = vertices[strutIndices[i, 0]];
            Point3d p2 = vertices[strutIndices[i, 1]];
            strutLines.Add(new Line(p1, p2));
        }

        // --- MANUAL INPUT SECTION ---

        /*
        int[,] radialCableIndices = new int[,]
        {
            {0,6},{0,7},{0,9},
            {1,2},{1,7},{1,8},
            {2,3},{2,9}, 
            {3,4},{3,5},
            {4,5},{4,8},
            {5,11},
            {6,7},{6,10},
            {8,10},
            {9,11},
            {10,11}
        };
        */

        // automatic routine
        /*
        int[,] radialCableIndices = new int[,]
        {
            {0,6},{0,7},  //{0,9},{1,7},{2,3},{4,8},{5,11},{6,10},
            {1,2},{1,8},
            {2,9}, 
            {3,4},{3,5},
            {4,5},
            {6,7},
            {8,10},
            {9,11},
            {10,11}
        };
        */

         // manual routine
        
        int[,] radialCableIndices = new int[,]
        {
            {0,6},{0,7},  //{0,9},{1,7},{2,3},{4,8},{5,11},{6,10},
            {3,4},{3,5},// {1,2},{1,8},{2,9},{8,10},{9,11},{10,11}
            {4,5},
            {6,7},

            {2,8},{2,11},{8,11},
            {1,9},{9,10},{1,10},
            //{2,4},{2,10},{0,10},

        };
        



        /*
        int[,] verticalCableIndices = new int[,]
        {
            {0,2},
            {1,3},
            {4,10},
            {5,9},
            {6,11},
            {7,8},

        };
        */

        //Automatic routine
        /*
        int[,] verticalCableIndices = new int[,]
        {
            {0,2},
            {1,3},
            {4,10},
            {5,9},
            {6,11},
            {7,8},
            {0,9},{1,7},{2,3},{4,8},{5,11},{6,10},

        };
        */

        // Manual routine
        int[,] verticalCableIndices = new int[,]
        {
            {0,2},
            {1,3},
            {4,10},
            {5,9},
            {6,11},
            {7,8},
            {0,9},{1,7},{2,3},{4,8},{5,11},{6,10},
            {1,2},{1,8},{2,9},{8,10},{9,11},{10,11}

        };


        // --- LINE GENERATION ---

        List<Line> radialCableLines = new List<Line>();
        for (int i = 0; i < radialCableIndices.GetLength(0); i++)
        {
            Point3d p1 = vertices[radialCableIndices[i, 0]];
            Point3d p2 = vertices[radialCableIndices[i, 1]];
            radialCableLines.Add(new Line(p1, p2));
        }

        List<Line> verticalCableLines = new List<Line>();
        for (int i = 0; i < verticalCableIndices.GetLength(0); i++)
        {
            Point3d p1 = vertices[verticalCableIndices[i, 0]];
            Point3d p2 = vertices[verticalCableIndices[i, 1]];
            verticalCableLines.Add(new Line(p1, p2));
        }

        // Points et labels
        List<string> textLabels = new List<string>();
        List<Point3d> labelPts = new List<Point3d>();
        for (int i = 0; i < vertices.Count; i++)
        {
            textLabels.Add(i.ToString());
            labelPts.Add(vertices[i] + new Vector3d(0, 0, radius * 0.05));
        }

        struts = strutLines;
        radialCables = radialCableLines;
        verticalCables = verticalCableLines;
        points = vertices;
        labels = textLabels;
        labelLocations = labelPts;
    }

    private List<Point3d> GenerateIcosahedron(Point3d center, double radius)
    {
        double phi = (1 + Math.Sqrt(5)) / 2;
        double a = 1.0;
        double b = 1.0 / phi;

        List<Point3d> verts = new List<Point3d>
        {
            new Point3d( 0,  b, -a),
            new Point3d( b,  a,  0),
            new Point3d(-b,  a,  0),
            new Point3d( 0,  b,  a),
            new Point3d( 0, -b,  a),
            new Point3d(-a,  0,  b),
            new Point3d( 0, -b, -a),
            new Point3d( a,  0, -b),
            new Point3d( a,  0,  b),
            new Point3d(-a,  0, -b),
            new Point3d( b, -a,  0),
            new Point3d(-b, -a,  0)
        };

        for (int i = 0; i < verts.Count; i++)
        {
            Vector3d dir = verts[i] - Point3d.Origin;
            dir.Unitize();
            verts[i] = center + dir * radius;
        }

        return verts;
    }
}
# ---------- end c_script ----------
# Ocahedron
c_script_2 = CSharpScript(center=point_2, radius=Slider(75, range=0..100))  # -> out, struts, radialCables, verticalCables, points, labels, labelLocations; inputs center: Point3d, radius: Double
# ---------- c_script_2: C# ----------
#region Usings
using System;
using System.Collections.Generic;
using Rhino.Geometry;
#endregion

public class Script_Instance : GH_ScriptInstance
{
    private void RunScript(
		Point3d center,
		double radius,
		ref object struts,
		ref object radialCables,
		ref object verticalCables,
		ref object points,
		ref object labels,
		ref object labelLocations)
    {
        List<Point3d> vertices = GenerateOctahedron(center, radius);

        // Struts: 3 compression members across the octahedron
        int[,] strutIndices = new int[,]
        {
            {0, 1}, {2, 3}, {4, 5}
        };

        List<Line> strutLines = new List<Line>();
        for (int i = 0; i < strutIndices.GetLength(0); i++)
        {
            Point3d p1 = vertices[strutIndices[i, 0]];
            Point3d p2 = vertices[strutIndices[i, 1]];
            strutLines.Add(new Line(p1, p2));
        }

        // Radial cables (in-plane connections on each face)
        int[,] radialCableIndices = new int[,]
        {
             {0, 3},  {0, 5},
            {1, 2},  {1, 4}, 
            {2, 4},
            {3, 5} //{0, 2},{0, 4},{1, 3},{1, 5}, {2, 5},{3, 4}, 
        };

        List<Line> radialCableLines = new List<Line>();
        for (int i = 0; i < radialCableIndices.GetLength(0); i++)
        {
            Point3d p1 = vertices[radialCableIndices[i, 0]];
            Point3d p2 = vertices[radialCableIndices[i, 1]];
            radialCableLines.Add(new Line(p1, p2));
        }

        // Vertical cables: the three remaining edges of the octahedron not covered
        int[,] verticalCableIndices = new int[,]
        {
            {0, 2},{0, 4},
            {1, 3},{1, 5}, 
            {2, 5},
            {3, 4}
        };

        List<Line> verticalCableLines = new List<Line>();
        for (int i = 0; i < verticalCableIndices.GetLength(0); i++)
        {
            Point3d p1 = vertices[verticalCableIndices[i, 0]];
            Point3d p2 = vertices[verticalCableIndices[i, 1]];
            verticalCableLines.Add(new Line(p1, p2));
        }

        // Labels and label points
        List<string> textLabels = new List<string>();
        List<Point3d> labelPts = new List<Point3d>();
        for (int i = 0; i < vertices.Count; i++)
        {
            textLabels.Add(i.ToString());
            labelPts.Add(vertices[i] + new Vector3d(0, 0, radius * 0.05));
        }

        struts = strutLines;
        radialCables = radialCableLines;
        verticalCables = verticalCableLines;
        points = vertices;
        labels = textLabels;
        labelLocations = labelPts;
    }

    private List<Point3d> GenerateOctahedron(Point3d center, double radius)
    {
        List<Point3d> verts = new List<Point3d>
        {
            new Point3d( 1,  0,  0),
            new Point3d(-1,  0,  0),
            new Point3d( 0,  1,  0),
            new Point3d( 0, -1,  0),
            new Point3d( 0,  0,  1),
            new Point3d( 0,  0, -1)
        };

        for (int i = 0; i < verts.Count; i++)
        {
            Vector3d dir = verts[i] - Point3d.Origin;
            dir.Unitize();
            verts[i] = center + dir * radius;
        }

        return verts;
    }
}
# ---------- end c_script_2 ----------
cluster_2 = T3()  # -> struts_2, radial_cables_2, vertical_cables_2
# Chose different tensegrities
star_3 = Star3()  # -> struts_2, radial_cables_2, vertical_cables_2
icosahedron = Icosahedron()  # -> struts_2, cables_1, cables_2
point_list = PointList(Points=c_script.points, Size=Slider(5, range=0..10))
radial_cables = Line(icosahedron.cables_1)
vertical_cables = Line(icosahedron.cables_2)
struts = Line(icosahedron.struts_2)
show = Show(G=cluster.vertical_cables_2)
radial_cables_2 = Line(cluster_2.radial_cables_2)
vertical_cables_2 = Line(cluster_2.vertical_cables_2)
radial_cables_3 = Line(star_3.radial_cables_2)
vertical_cables_3 = Line(star_3.vertical_cables_2)
point_list_2 = PointList(Points=c_script_2.points, Size=Slider(7, range=0..10))
struts_2 = Line(cluster_2.struts_2)
struts_3 = Line(star_3.struts_2)
show_2 = Show(G=cluster.radial_cables_2)
# Change the value of time to vary the radial cable length
time = Slider(0, range=0..1)
show_3 = Show(G=[c_script.radialCables, c_script_2.radialCables])
show_4 = Show(G=[c_script.verticalCables, c_script_2.verticalCables])
line = Line([cluster.vertical_cables_2, c_script.verticalCables, c_script_2.verticalCables])
path_mapper = PathMapper(show, source="{0;0;0;0}", target="{3;0}")
path_mapper_2 = PathMapper(show_2, source="{0;0;0;0}", target="{2;0}")
line_2 = Line([cluster.struts_2, c_script.struts, c_script_2.struts])
line_3 = Line([cluster.radial_cables_2, c_script.radialCables, c_script_2.radialCables])
entwine = Entwine(Branch00=struts_2, Branch01=radial_cables_2, Branch02=vertical_cables_2, FlattenInputs=True)  # -> simplify(graft(Result))
path_mapper_3 = PathMapper(show_3, source="{0;0}", target="{2;0}")
path_mapper_4 = PathMapper(show_4, source="{0;0}", target="{3;0}")
entwine_2 = Entwine(Branch00=struts_3, Branch01=radial_cables_3, Branch02=vertical_cables_3, FlattenInputs=True)  # -> simplify(graft(Result))
entwine_3 = Entwine(Branch00=struts, Branch01=radial_cables, Branch02=vertical_cables, FlattenInputs=True)  # -> simplify(graft(Result))
range = Range(Domain=Domain(0, 1), Steps=Slider(5, range=0..10))
shatter = Shatter(Curve=line, Parameters=range)
shatter_2 = Shatter(Curve=line_3, Parameters=range)
strength_vertical_cables = Slider(42.69, range=0..100)
strength_radial_cables = Slider(501.3, range=0..1000)
pretension_factor_vertical_cable = Slider(0.92, range=0..1)
_1_unit = Data(entwine_3)
expression = Expression(x=time, Expression=" 1 - 0.98 * x")
anchor = Anchor(Strength=10000)
length = Length(Curve=shatter_2)
length_2 = Length(Curve=shatter)
unit_z = UnitZ(Factor=Slider(88, range=0..1000))
cables = Line([shatter, shatter_2])
move = Move(Geometry=_1_unit, Motion=unit_z)  # -> Geometry, Transform
multiplication = Multiplication(A=length_2, B=pretension_factor_vertical_cable)
length_line = LengthLine(Line=shatter, Length=multiplication, Strength=strength_vertical_cables)
length_line_2 = LengthLine(Line=line_2, Length=line_2, Strength=Slider(7934, range=0..100000))
multiplication_2 = Multiplication(A=length, B=expression)
length_line_3 = LengthLine(Line=shatter_2, Length=multiplication_2, Strength=strength_radial_cables)
end_points = EndPoints(Curve=move.Geometry)  # -> Start, End
list_item = ListItem(List=flatten(end_points.Start), Index=0, Wrap=True)
collider = Collider(Objects=flatten([line_2, cables]), Radii=Slider(1.346, range=0..10), Strength=Slider(50, range=0..1000))
yz_plane = YZPlane(Origin=list_item)
rotate = Rotate(Geometry=move.Geometry, Angle=Slider(1, range=0..1), Plane=yz_plane)  # -> Geometry, Transform
show_5 = Show(G=[c_script.points, c_script_2.points])
path_mapper_5 = PathMapper(show_5, source="{0;0}", target="{1;0}")
merge = Merge(
    Data1=length_line_2,
    Data2=length_line_3,
    Data3=length_line,
    Data4=path_mapper_5,
    Data5=[path_mapper_3, path_mapper_2],
    Data6=[path_mapper, path_mapper_4])
entwine_4 = Entwine(Branch00=merge, Branch01=collider, FlattenInputs=True)
solver = Solver(GoalObjects=entwine_4, Reset=Button(), Threshold="1e-6", Tolerance=0.0001, On=Toggle(True))  # -> I, V, O
dispatch_elements = DispatchElements(geometry=rotate.Geometry)  # -> struts_2, radial_cables_2, vertical_cables_2
panel = Panel(path_mapper_5)
clean_tree = CleanTree(RemoveNulls=True, RemoveInvalid=True, RemoveEmpty=False, Tree=solver.O)
end_points_2 = EndPoints(Curve=dispatch_elements.struts_2)  # -> Start, End
unflatten_tree = UnflattenTree(Tree=clean_tree, Guide=merge)
cull_duplicates = CullDuplicates(Points=[end_points_2.Start, end_points_2.End], Tolerance=0.1, CullMode=3)  # -> flatten(Points), Indices, Valence
panel_2 = Panel("0;0")
trim = TrimTree(Tree=unflatten_tree, Depth=1)
range_2 = Range(Domain=Domain(0, 1), Steps=Slider(5, range=0..10))
point_list_3 = PointList(Points=unflatten_tree, Size=Slider(8, range=0..100))
list_length = ListLength(List=cull_duplicates.Points)
branch = TreeBranch(Tree=simplify(trim), Path="3", MaintainPaths=True)
strength_radial_cables_2 = Slider(51.376, range=0..100)
branch_2 = TreeBranch(Tree=simplify(trim), Path="2", MaintainPaths=True)
# Play with these to change lengths and strengths
pretension_factor = Slider(0.9, range=0..1)
strength_vertical_cables_2 = Slider(58.8, range=0..100)
pretension_factor_2 = Slider(0.79, range=0..1)
shatter_3 = Shatter(Curve=dispatch_elements.radial_cables_2, Parameters=range_2)
division = Division(A=Slider(100, range=0..100), B=list_length)
branch_3 = TreeBranch(Tree=simplify(trim), Path=Slider(0, range=0..10), MaintainPaths=True)
shatter_4 = Shatter(Curve=dispatch_elements.vertical_cables_2, Parameters=range_2)

# ---- group: Cable to enable to shrink unit
length_3 = Length(Curve=dispatch_elements.radial_cables_2)
multiplication_3 = Multiplication(A=length_3, B=Slider(0.13, range=0..1))
length_line_4 = LengthLine(Line=dispatch_elements.radial_cables_2, Length=multiplication_3, Strength=Slider(10, range=0..10))  # disabled

# ----
cables_2 = Line([shatter_3, shatter_4])
panel_3 = Panel(trim)
unit_z_2 = UnitZ(Factor=division)
length_4 = Length(Curve=shatter_3)
length_5 = Length(Curve=shatter_4)
pipe = Pipe(Curve=branch_3, Radius=Slider(1, range=0..10), Caps=0)
negative = Negative(Value=unit_z_2)
point_3 = Point(cull_duplicates.Points)
multiplication_4 = Multiplication(A=length_4, B=pretension_factor_2)
multiplication_5 = Multiplication(A=length_5, B=pretension_factor)
pipe_2 = Pipe(Curve=branch, Radius=Slider(0.2, range=0..1), Caps=0)
pipe_3 = Pipe(Curve=branch_2, Radius=Slider(0.2, range=0..1), Caps=0)
length_line_5 = LengthLine(Line=dispatch_elements.struts_2, Length=dispatch_elements.struts_2, Strength=Slider(7934, range=0..100000))
length_line_6 = LengthLine(Line=shatter_3, Length=multiplication_4, Strength=strength_radial_cables_2)
length_line_7 = LengthLine(Line=shatter_4, Length=multiplication_5, Strength=strength_vertical_cables_2)
load = Load(Point=cull_duplicates.Points, ForceVector=negative, Weighting=1)
floor = Floor(Strength=Slider(0.8, range=0..1))  # disabled
floorfriction = FloorFriction(Points=cull_duplicates.Points, Limit=0.1, Strength=Slider(1000, range=0..1000))
collider_2 = Collider(
    Objects=flatten([dispatch_elements.struts_2, cables_2]),
    Radii=Slider(1, range=0..10),
    Strength=Slider(50, range=0..1000))
custom_preview = CustomPreview(Geometry=pipe_3, Material=ColourSwatch(SwatchColor=RGB(13, 215, 139)))
custom_preview_2 = CustomPreview(Geometry=pipe_2, Material=ColourSwatch(SwatchColor=RGB(240, 19, 139)))
custom_preview_3 = CustomPreview(Geometry=pipe, Material=ColourSwatch(SwatchColor=RGB(110, 127, 139)))
merge_2 = Merge(Data1=length_line_5, Data2=length_line_6, Data3=length_line_7, Data4=length_line_4)
entwine_5 = Entwine(Branch00=merge_2, Branch01=[floor, collider_2, load, floorfriction], FlattenInputs=True)

# ---- group: Solver (use bouncy for multiple units)
# Switch these two buttons to run the simulation
button = Button()
solver_2 = Solver(GoalObjects=entwine_5, Reset=button, Threshold="1e-6", Tolerance=0.0001, On=Toggle(False))  # -> I, V, O
bouncysolver = BouncySolver(
    GoalObjects=entwine_5,
    Reset=Button(),
    Threshold="1e-6",
    Tolerance=0.0001,
    Damping=Slider(0.9997, range=0.8..1),
    Iterations=Slider(10, range=0..200),
    On=Toggle(False))  # -> I, V, O

# ----
zombiesolver = ZombieSolver(GoalObjects=entwine_5, Threshold=1e-10, Tolerance=0.0001, MaxIterations=50000)  # -> I, V, O
value_list = ValueList({"One": 0, "Two": 1, "Three": 2}, selected="One")

# ---- group: choose simulation style
stream_filter = StreamFilter(Gate=value_list, Stream0=solver_2.O, Stream1=bouncysolver.O, Stream2=zombiesolver.O)

# ----
clean_tree_2 = CleanTree(RemoveNulls=True, RemoveInvalid=True, RemoveEmpty=False, Tree=stream_filter)
unflatten_tree_2 = UnflattenTree(Tree=clean_tree_2, Guide=merge_2)
dispatch_elements_2 = DispatchElements(geometry=unflatten_tree_2)  # -> struts_2, radial_cables_2, vertical_cables_2
length_6 = Length(Curve=dispatch_elements_2.struts_2)
join_curves = JoinCurves(Curves=dispatch_elements_2.radial_cables_2, Preserve=False)
join_curves_2 = JoinCurves(Curves=dispatch_elements_2.vertical_cables_2, Preserve=False)
length_7 = Length(Curve=join_curves_2)
length_8 = Length(Curve=join_curves)

join_curves_3 = JoinCurves(Curves=flatten(join_curves), Preserve=invert(False))
dispatch = Dispatch(List=join_curves_3, DispatchPattern=[True, False])  # -> ListA, ListB
flip_curve = FlipCurve(Curve=dispatch.ListB)  # -> Curve, Flag
loft = Loft(
    Curves=[flip_curve.Curve, dispatch.ListA],
    Options={Adjust=True, Closed=False, LoftEnds=0, LoftSimp=0, LoftType=5, Rebuild=10, Refit=0.01})
cap_holes = CapHoles(Brep=loft)
volume = Volume(Geometry=cap_holes)  # -> Volume, Centroid
number = Number(volume.Volume)
panel_4 = Panel(number)

# ---- group: struts lengths
panel_5 = Panel(length_6)

# ---- group: Radial cables lengths
panel_6 = Panel(length_8)

# ---- group: vertical cables lengths
panel_7 = Panel(length_7)

# ----
custom_preview_4 = CustomPreview(Geometry=dispatch_elements_2.struts_2, Material=ColourSwatch(SwatchColor=RGB(4, 217, 0)))
custom_preview_5 = CustomPreview(Geometry=dispatch_elements_2.vertical_cables_2, Material=ColourSwatch(SwatchColor=RGB(0, 33, 217)))
custom_preview_6 = CustomPreview(Geometry=dispatch_elements_2.radial_cables_2, Material=ColourSwatch(SwatchColor=RGB(0, 170, 217)))
galapagos = Galapagos(fitness=number, gene=[pretension_factor_2, pretension_factor])

# ==== cluster DispatchElements
geometry = ClusterInput()
geometry_2 = Data(geometry)
split_tree = SplitTree(Data=geometry_2, Masks=flatten("{0;*}"))  # -> Positive, Negative
split_tree_2 = SplitTree(Data=split_tree.Negative, Masks=flatten("{1;*}"))  # -> Positive, Negative
radial_cables = Line(split_tree_2.Positive)
vertical_cables = Line(split_tree_2.Negative)
struts = Line(split_tree.Positive)
struts_2 = ClusterOutput(struts)
radial_cables_2 = ClusterOutput(radial_cables)
vertical_cables_2 = ClusterOutput(vertical_cables)

# ==== cluster Star3
radius = Slider(50, range=0..50)
nb_of_struts = Slider(3, range=0..10)
polygon = Polygon(Plane=PlaneXY(0, 0, 0), Radius=radius, Segments=nb_of_struts, FilletRadius=0)  # -> Polygon, Length
height = Slider(80, range=0..100)
unit_z = UnitZ(Factor=Slider(0, range=0..50))
move = Move(Geometry=polygon.Polygon, Motion=unit_z)  # -> Geometry, Transform
rotate = Rotate(Geometry=move.Geometry, Angle=Slider(3, range=0..3), Plane=PlaneXY(0, 0, 0))  # -> Geometry, Transform
unit_z_2 = UnitZ(Factor=height)
move_2 = Move(Geometry=rotate.Geometry, Motion=unit_z_2)  # -> Geometry, Transform
control_points = ControlPoints(Curve=move.Geometry)  # -> Points, Weights, Knots
control_points_2 = ControlPoints(Curve=move_2.Geometry)  # -> Points, Weights, Knots
removeduplicatepts = RemoveDuplicatePts(Points=control_points.Points, Tolerance=0.01)
removeduplicatepts_2 = RemoveDuplicatePts(Points=control_points_2.Points, Tolerance=0.01)
polygon_center = PolygonCenter(Polyline=move_2.Geometry)  # -> CenterV, CenterE, CenterA
polygon_center_2 = PolygonCenter(Polyline=move.Geometry)  # -> CenterV, CenterE, CenterA
shift_list = ShiftList(List=removeduplicatepts, Shift="1", Wrap=True)
line = Line(StartPoint=removeduplicatepts, EndPoint=removeduplicatepts_2)
line_2 = Line(StartPoint=polygon_center_2.CenterV, EndPoint=removeduplicatepts)
line_3 = Line(StartPoint=polygon_center.CenterV, EndPoint=removeduplicatepts_2)
line_4 = Line(StartPoint=removeduplicatepts_2, EndPoint=shift_list)
vertical_cables = Line(line_4)
radial_cables = Line([line_2, line_3])
struts = Line(line)
struts_2 = ClusterOutput(struts)
radial_cables_2 = ClusterOutput(radial_cables)
vertical_cables_2 = ClusterOutput(vertical_cables)
length = Length(Curve=vertical_cables)
length_2 = Length(Curve=radial_cables)
panel = Panel(length_2)
panel_2 = Panel(length)

# ==== cluster T3
radius = Slider(50, range=0..50)
nb_of_struts = Slider(3, range=0..10)
polygon = Polygon(Plane=PlaneXY(0, 0, 0), Radius=radius, Segments=nb_of_struts, FilletRadius=0)  # -> Polygon, Length
height = Slider(80, range=0..100)
rotate = Rotate(Geometry=polygon.Polygon, Angle=Slider(2.2, range=0..3), Plane=PlaneXY(0, 0, 0))  # -> Geometry, Transform
unit_z = UnitZ(Factor=height)
move = Move(Geometry=rotate.Geometry, Motion=unit_z)  # -> Geometry, Transform
control_points = ControlPoints(Curve=polygon.Polygon)  # -> Points, Weights, Knots
control_points_2 = ControlPoints(Curve=move.Geometry)  # -> Points, Weights, Knots
removeduplicatepts = RemoveDuplicatePts(Points=control_points.Points, Tolerance=0.01)
removeduplicatepts_2 = RemoveDuplicatePts(Points=control_points_2.Points, Tolerance=0.01)
shift_list = ShiftList(List=removeduplicatepts, Shift="1", Wrap=True)
shift_list_2 = ShiftList(List=removeduplicatepts_2, Shift="1", Wrap=True)
line = Line(StartPoint=removeduplicatepts, EndPoint=removeduplicatepts_2)
line_2 = Line(StartPoint=shift_list_2, EndPoint=removeduplicatepts_2)
line_3 = Line(StartPoint=shift_list, EndPoint=removeduplicatepts)
line_4 = Line(StartPoint=removeduplicatepts_2, EndPoint=shift_list)
vertical_cables = Line(line_4)
radial_cables = Line([line_3, line_2])
struts = Line(line)
radial_cables_2 = ClusterOutput(radial_cables)
vertical_cables_2 = ClusterOutput(vertical_cables)
struts_2 = ClusterOutput(struts)

# ==== cluster Icosahedron
multiplication = Multiplication(A="pi", B=Slider(0.207, range=-1..1))
unit_z = UnitZ(Factor=Slider(44, range=0..50))
weaverbird_s_mesh_mesh_icosahedron = WeaverbirdsMeshMeshIcosahedron(Plane=PlaneXY(0, 0, 0), Radius=Slider(55, range=0..70))
rotate_3d = Rotate3D(Geometry=weaverbird_s_mesh_mesh_icosahedron, Angle=multiplication, Center=Point(0, 0, 0), Axis="{0,1,0}")  # -> Geometry, Transform
move = Move(Geometry=rotate_3d.Geometry, Motion=unit_z)  # -> Geometry, Transform
deconstruct_mesh = DeconstructMesh(Mesh=move.Geometry)  # -> Vertices, Faces, Colours, Normals
removeduplicatepts = RemoveDuplicatePts(Points=deconstruct_mesh.Vertices, Tolerance=0.01)
list_item = ListItem(List=removeduplicatepts, Index=0, Wrap=True)  # -> Item, Item1, Item2, Item3, Item4, Item5, Item6, Item7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
line = Line(StartPoint=list_item.Item, EndPoint=list_item.Item3)
line_2 = Line(StartPoint=list_item.Item, EndPoint=list_item.Item1)

line_3 = Line(StartPoint=list_item.Item2, EndPoint=list_item.Item11)
line_4 = Line(StartPoint=list_item.Item5, EndPoint=list_item.Item6)
line_5 = Line(StartPoint=list_item.Item8, EndPoint=list_item.Item10)
line_6 = Line(StartPoint=list_item.Item, EndPoint=list_item.Item9)
line_7 = Line(StartPoint=list_item.Item1, EndPoint=list_item.Item3)
line_8 = Line(StartPoint=list_item.Item4, EndPoint=list_item.Item7)

line_9 = Line(StartPoint=list_item.Item5, EndPoint=list_item.Item)
line_10 = Line(StartPoint=list_item.Item10, EndPoint=list_item.Item5)
line_11 = Line(StartPoint=list_item.Item9, EndPoint=list_item.Item8)
line_12 = Line(StartPoint=list_item.Item9, EndPoint=list_item.Item4)
line_13 = Line(StartPoint=list_item.Item4, EndPoint=list_item.Item8)
line_14 = Line(StartPoint=list_item.Item8, EndPoint=list_item.Item7)
line_15 = Line(StartPoint=list_item.Item8, EndPoint=list_item.Item11)
line_16 = Line(StartPoint=list_item.Item2, EndPoint=list_item.Item6)
line_17 = Line(StartPoint=list_item.Item2, EndPoint=list_item.Item7)
line_18 = Line(StartPoint=list_item.Item6, EndPoint=list_item.Item10)
line_19 = Line(StartPoint=list_item.Item6, EndPoint=list_item.Item1)
line_20 = Line(StartPoint=list_item.Item10, EndPoint=list_item.Item9)
line_21 = Line(StartPoint=list_item.Item11, EndPoint=list_item.Item7)
line_22 = Line(StartPoint=list_item.Item5, EndPoint=list_item.Item1)
line_23 = Line(StartPoint=list_item.Item2, EndPoint=list_item.Item1)
line_24 = Line(StartPoint=list_item.Item6, EndPoint=list_item.Item11)
line_25 = Line(StartPoint=list_item.Item10, EndPoint=list_item.Item11)
line_26 = Line(StartPoint=list_item.Item5, EndPoint=list_item.Item9)
line_27 = Line(StartPoint=list_item.Item, EndPoint=list_item.Item4)
line_28 = Line(StartPoint=list_item.Item3, EndPoint=list_item.Item2)
line_29 = Line(StartPoint=list_item.Item3, EndPoint=list_item.Item7)
line_30 = Line(StartPoint=list_item.Item3, EndPoint=list_item.Item4)
cables = Line([line, line_2, line_9, line_22, line_27, line_30, line_29, line_28, line_16, line_17, line_23, line_24, line_18, line_19, line_25, line_20, line_10, line_26, line_11, line_12, line_13, line_14, line_15, line_21])
struts = Line([line_6, line_7, line_3, line_8, line_4, line_5])
move_2 = Move(Motion=Vector(0, 0, 10))  # -> Geometry, Transform
list_length = ListLength(List=cables)  # -> expr("x/2", Length)
dispatch = Dispatch(List=cables, DispatchPattern=[True, False])  # -> ListA, ListB
split_list = SplitList(List=cables, Index=list_length)  # -> ListA, ListB
struts_2 = ClusterOutput(struts)
cables_1 = ClusterOutput(dispatch.ListA)
cables_2 = ClusterOutput(dispatch.ListB)
line_31 = Line(dispatch.ListA)
